% Requirement links of CruiseControl_dd.m (R2019b)

% line 64 relates to CruiseControl_TestSuite.slreqx#29: Target speed will be limited between 20 and 90 mph
maxtspeed.Value = 90;

% line 70 relates to CruiseControl_TestSuite.slreqx#29: Target speed will be limited between 20 and 90 mph
mintspeed.Value = 20;