test file "CruiseControl_TestCase"
  coverage: Decision, MCDC, Condition

suite "TestSuite"

  case "Init Not Enable or Engaged" [simulation]
    model CruiseControl_Req, harness CruiseControl_Harness
    signal scenario: Init Not Enable or Engaged (CruiseControl_Harness/Signal Builder)

  case "Not Engaged with Enable" [simulation]
    model CruiseControl_Req, harness CruiseControl_Harness
    signal scenario: Not Engaged with Enable (CruiseControl_Harness/Signal Builder)

  case "Disengage with Disable" [simulation]
    model CruiseControl_Req, harness CruiseControl_Harness
    signal scenario: Disengage with Disable (CruiseControl_Harness/Signal Builder)

  case "Engage 1st with CoastSetSW" [simulation]
    model CruiseControl_Req, harness CruiseControl_Harness
    signal scenario: Engage 1st with CoastSetSW (CruiseControl_Harness/Signal Builder)

  case "No Engage 1st with AccelResSW" [simulation]
    model CruiseControl_Req, harness CruiseControl_Harness
    signal scenario: No Engage 1st with AccelResSW (CruiseControl_Harness/Signal Builder)

  case "Disengage with Brake" [simulation]
    model CruiseControl_Req, harness CruiseControl_Harness
    signal scenario: Disengage with Brake (CruiseControl_Harness/Signal Builder)

  case "Re-Engage with CoastSetSw" [simulation]
    model CruiseControl_Req, harness CruiseControl_Harness
    signal scenario: Re-Engage with CoastSetSw (CruiseControl_Harness/Signal Builder)

  case "Re-Engage with AccelResSw" [simulation]
    model CruiseControl_Req, harness CruiseControl_Harness
    signal scenario: Re-Engage with AccelResSw (CruiseControl_Harness/Signal Builder)

  case "Engaged Decel with CoastSetSW" [simulation]
    model CruiseControl_Req, harness CruiseControl_Harness
    signal scenario: Engaged Decel with CoastSetSW (CruiseControl_Harness/Signal Builder)

  case "Engaged Accel with AccelResSW" [simulation]
    model CruiseControl_Req, harness CruiseControl_Harness
    signal scenario: Engaged Accel with AccelResSW (CruiseControl_Harness/Signal Builder)

  case "Engagd Decel with CoastSet Hold" [simulation]
    model CruiseControl_Req, harness CruiseControl_Harness
    signal scenario: Engagd Decel with CoastSet Hold (CruiseControl_Harness/Signal Builder)

  case "Engagd Accel with AccelRes Hold" [simulation]
    model CruiseControl_Req, harness CruiseControl_Harness
    signal scenario: Engagd Accel with AccelRes Hold (CruiseControl_Harness/Signal Builder)

  case "Engage CoastSetSw Veh Spd" [simulation]
    model CruiseControl_Req, harness CruiseControl_Harness
    signal scenario: Engage CoastSetSw Veh Spd (CruiseControl_Harness/Signal Builder)

  case "Engage AccelResSw Veh Spd" [simulation]
    model CruiseControl_Req, harness CruiseControl_Harness
    signal scenario: Engage AccelResSw Veh Spd (CruiseControl_Harness/Signal Builder)