% Requirement links of CruiseControl_TestCase.mldatx (R2017b)

item 1 links to MW_CruiseControl.slreqx#21: “Accelerate” input increases target speed only when engaged (active)
item 2 links to MW_CruiseControl.slreqx#23: Continuous “Accelerate” input increases target speed at a fixed rate and only when engaged (active)
item 3 links to MW_CruiseControl.slreqx#27: Transition to engaged (active) will only be permitted for vehicle speeds between 20 and 90 mph
item 4 links to MW_CruiseControl.slreqx#18: “Resume” input ignored until the initial transition from disengaged (inactive) to engaged (active)
item 5 links to MW_CruiseControl.slreqx#14: Disabled (off) during start-up
item 6 links to MW_CruiseControl.slreqx#17: Initial transition from disengaged (inactive) to engaged (active) only with “Set Speed” input after enabling (on)
item 7 links to MW_CruiseControl.slreqx#16: Disengaged (not active) when disabled (off)
item 8 links to MW_CruiseControl.slreqx#19: Subsequent transition from disengaged (inactive) to engaged (active) with “Set Speed” input while enabled (on)
item 9 links to MW_CruiseControl.slreqx#20: Subsequent transition from disengaged (inactive) to engaged (active) with “Resume” input while enabled (on)
item 10 links to MW_CruiseControl.slreqx#24: Continuous “Decelerate” input decreases target speed at a fixed rate and only when engaged (active)
item 11 links to MW_CruiseControl.slreqx#26: Vehicle braking will transition system to disengaged (inactive) when engaged (active)
item 12 links to MW_CruiseControl.slreqx#15: Not engaged with enabling (on)
item 13 links to MW_CruiseControl.slreqx#22: “Decelerate” input decreases target speed only when engaged (active)
item 14 links to MW_CruiseControl.slreqx#27: Transition to engaged (active) will only be permitted for vehicle speeds between 20 and 90 mph