% Requirement links of CruiseControl_TestSuite.slreqx (R2019b)

#35 verifies #2: Enable/Disable Switch
#36 verifies #3: Set Speed/Decelerate Button
#37 verifies #4: Resume Speed/Accelerate Button
#38 verifies #5: Vehicle Speed Input
#39 verifies #6: Vehicle Brake Input
#40 verifies #8: Engaged (active) Output
#41 verifies #9: Target Speed Output