# Requirement set CruiseControl_TestSuite (R2019b)

## 1 [#1] Interface (Container)
All interface requirements

### 1.1 [#2] Enable/Disable Switch
The controller shall have an On/Off Switch to enable/disable the operation of the cruise control system.

### 1.2 [#3] Set Speed/Decelerate Button
The controller shall have an input button to:
- set the target speed to the current vehicle speed when the cruise control is not engaged (active)
- decelerate (reduce) the target speed when the cruise control is engaged (active)

### 1.3 [#4] Resume Speed/Accelerate Button
The controller shall have an input button to:
- set the target speed to last acceptable target speed when the cruise control is not engaged (active)
- accelerate (increase) the target speed when the cruise control is active

### 1.4 [#5] Vehicle Speed Input
The controller shall have a vehicle speed input to be used by the target speed algorithm.

### 1.5 [#6] Vehicle Brake Input
The controller shall have a vehicle brake input to indicate when the driver has applied the brake pedal.

### 1.6 [#8] Engaged (active) Output
The controller shall have an output signal to indicate that the controller is engaged (active) .

### 1.7 [#9] Target Speed Output
The controller shall have an output signal to indicate that the target speed of the controller.

## 2 [#10] Functional (Container)
All non-safety functional requirements

### 2.1 [#14] Disabled (off) during start-up
Initial state of cruise control system shall be disabled.

### 2.2 [#15] Not engaged with enabling (on)
The cruise control system shall not be initially engaged with enabling.

### 2.3 [#16] Disengaged (not active) when disabled (off)
The cruise control system shall disengage with disabling.

### 2.4 [#17] Initial transition from disengaged (inactive) to engaged (active) only with “Set Speed” input after enabling (on)
The cruise control shall only transition to engaged (active) the first time after the system has been enabled with a “Set Speed” input. Target speed will be set to current vehicle speed.

### 2.5 [#18] “Resume” input ignored until the initial transition from disengaged (inactive) to engaged (active)
The cruise control shall ignore the “Resume” input until the initial transition to engaged (active) the first time after the system has been enabled.

### 2.6 [#19] Subsequent transition from disengaged (inactive) to engaged (active) with “Set Speed” input while enabled (on)
The cruise control shall transition to engaged (active) from disengaged with a “Set Speed” input when the system is enabled.

### 2.7 [#20] Subsequent transition from disengaged (inactive) to engaged (active) with “Resume” input while enabled (on)
The cruise control shall transition to engaged (active) from disengaged after the initial transition to engaged (active).

### 2.8 [#21] “Accelerate” input increases target speed only when engaged (active)
The target speed of the cruise control system shall increase by (1 mph, up to the limit) for the “Accelerate” input only when engaged. The “Accelerate” input is ignored when disengaged.

### 2.9 [#22] “Decelerate” input decreases target speed only when engaged (active)
The target speed of the cruise control system shall decrease by (1 mph, down to the limit) for the “Decelerate” input only when engaged. The “Decelerate” input is ignored when disengaged.

### 2.10 [#23] Continuous “Accelerate” input increases target speed at a fixed rate and only when engaged (active)
The target speed of the cruise control system shall increase by a fixed rate (tunable) when the “Accelerate” input is continuously held and only when engaged. A continuously held “Accelerate” input is ignored when disengaged.

### 2.11 [#24] Continuous “Decelerate” input decreases target speed at a fixed rate and only when engaged (active)
The target speed of the cruise control system shall decrease by a fixed rate (tunable) when the “Decelerate” input is continuously held and only when engaged. A continuously held “Decelerate” input is ignored when disengaged.

## 3 [#25] Safety (Container)
All safety derived functional requirements

### 3.1 [#26] Vehicle braking will transition system to disengaged (inactive) when engaged (active)
The cruise control system shall transition to disengaged from engaged when a braking event has occurred.

### 3.2 [#27] Transition to engaged (active) will only be permitted for vehicle speeds between 20 and 90 mph
The cruise control system target speed shall not transition to engaged unless the current vehicle speed is between 20 and 90 mph for safe operation.

### 3.3 [#28] Transition to disengaged (inactive) when vehicle speed is outside the limits of 20 to 90 mph
The cruise control system target speed shall transition to disengaged when the current vehicle speed is outside the limits of 20 to 90 mph for safe operation.

### 3.4 [#29] Target speed will be limited between 20 and 90 mph
The cruise control system target speed shall be limited between 20 and 90 mph for safe operation.

### 3.5 [#34] Disengage when braking occurs
The cruise control system shall transition to disengaged from engaged within 0.25 seconds after a braking event has occurred.

## 4 [#30] Justifications (Justification)

### 4.1 [#31] Functional heading (Justification)

### 4.2 [#32] Interface heading (Justification)

### 4.3 [#35] Enable/Disable Switch is implemented (Justification)

### 4.4 [#36] Decelerate button is implemented (Justification)

### 4.5 [#37] Accelerate button is implemented (Justification)

### 4.6 [#38] Speed input is implemented (Justification)

### 4.7 [#39] Brake input is implemented (Justification)

### 4.8 [#40] Engaged output is implemented (Justification)

### 4.9 [#41] Target speed output is implemented (Justification)