test file "CruiseControl_TestSuiteTEST"
  cleanup callback:
    close all;
  coverage: Decision, MCDC, Condition

suite "CruiseControl_TestSuite"

  case "Disengage upon braking event" [baseline]
    model CruiseControl_TestSuite, harness CruiseControl_TestSuite_Harness_Disengage_upon_braking

  case "Disengage when disabling" [baseline]
    model CruiseControl_TestSuite, harness CruiseControl_TestSuite_Harness_Disengage_when_disabling

  case "Accelerate at fixed rate" [baseline]
    model CruiseControl_TestSuite, harness CruiseControl_TestSuite_Harness_Accel_fixed_rate

  case "Accelerate only when engaged" [baseline]
    model CruiseControl_TestSuite, harness CruiseControl_TestSuite_Harness_Accel_only_engaged

  case "Decel at fixed rate" [baseline]
    model CruiseControl_TestSuite, harness CruiseControl_TestSuite_Harness_Decel_fixed_rate

  case "Decel only when engaged" [baseline]
    model CruiseControl_TestSuite, harness CruiseControl_TestSuite_Harness_Decel_only_engaged

  case "Disabled during start-up" [baseline]
    model CruiseControl_TestSuite, harness CruiseControl_TestSuite_Harness_Disable_during_startup

  case "Disengaged when enabled" [baseline]
    model CruiseControl_TestSuite, harness CruiseControl_TestSuite_Harness_Disengaged_when_enabled

  case "Re-engage after being disengaged" [baseline]
    model CruiseControl_TestSuite, harness CruiseControl_TestSuite_Harness_Engage_after_disengage

  case "Engage with Set switch" [baseline]
    model CruiseControl_TestSuite, harness CruiseControl_TestSuite_Harness_Engage_when_set

  case "Ignore Resume until engaged" [baseline]
    model CruiseControl_TestSuite, harness CruiseControl_TestSuite_Harness_Ignore_resume

  case "Target speed limit - high" [baseline]
    model CruiseControl_TestSuite, harness CruiseControl_TestSuite_Harness_Target_speed_limits_hi

  case "Target speed limit - low" [baseline]
    model CruiseControl_TestSuite, harness CruiseControl_TestSuite_Harness_Target_speed_limits_low

  case "Disengage when speed outside threshold" [baseline]
    model CruiseControl_TestSuite, harness CruiseControl_TestSuite_Harness_speed_thresholds_disengage

  case "Engage when speed within threshold" [baseline]
    model CruiseControl_TestSuite, harness CruiseControl_TestSuite_Harness_speed_thresholds_engage