test file "CruiseControl_C_Tests"
  coverage: Decision, MCDC, Condition

suite "Test Suite"

  case "C_Code_Test_SB" [simulation]
    model CruiseControl_C_main, harness CruiseControl_C_main_SB_Full_Harness
    signal scenario: Init Not Enable or Engaged (CruiseControl_C_main_SB_Full_Harness/Harness Inputs)
    iterations:
      Init Not Enable or Engaged: SignalBuilderGroup "Init Not Enable or Engaged"
      Not Engaged with Enable: SignalBuilderGroup "Not Engaged with Enable"
      Disengage with Disable: SignalBuilderGroup "Disengage with Disable"
      Engage 1st with CoastSetSW: SignalBuilderGroup "Engage 1st with CoastSetSW"
      No Engage 1st with AccelResSW: SignalBuilderGroup "No Engage 1st with AccelResSW"
      Disengage with Brake: SignalBuilderGroup "Disengage with Brake"
      Re-Engage with CoastSetSw: SignalBuilderGroup "Re-Engage with CoastSetSw"
      Re-Engage with AccelResSw: SignalBuilderGroup "Re-Engage with AccelResSw"
      Engaged Decel with CoastSetSW: SignalBuilderGroup "Engaged Decel with CoastSetSW"
      Engaged Accel with AccelResSW: SignalBuilderGroup "Engaged Accel with AccelResSW"
      Engagd Decel with CoastSet Hold: SignalBuilderGroup "Engagd Decel with CoastSet Hold"
      Engagd Accel with AccelRes Hold: SignalBuilderGroup "Engagd Accel with AccelRes Hold"
      Engage CoastSetSw Veh Spd: SignalBuilderGroup "Engage CoastSetSw Veh Spd"
      Engage AccelResSw Veh Spd: SignalBuilderGroup "Engage AccelResSw Veh Spd"
      Engage Veh Spd Edge: SignalBuilderGroup "Engage Veh Spd Edge"
      Disengage Veh Spd Edge: SignalBuilderGroup "Disengage Veh Spd Edge"
      Disengage from CoastSet Hold: SignalBuilderGroup "Disengage from CoastSet Hold"
      Disengage from AccelRes Hold: SignalBuilderGroup "Disengage from AccelRes Hold"
      Disengage Veh Spd Edge Hold: SignalBuilderGroup "Disengage Veh Spd Edge Hold"

  case "C_Code_Test_SigEd" [simulation]
    model CruiseControl_C_main, harness CruiseControl_C_main_SigEdit_Harness
    iterations:
      Disengage_with_Brake: SignalBuilderGroup "Disengage_with_Brake"
      Disengage_with_Disable: SignalBuilderGroup "Disengage_with_Disable"
      Engage_1st_with_CoastSetSW: SignalBuilderGroup "Engage_1st_with_CoastSetSW"
      Init_Not_Enable_or_Engaged: SignalBuilderGroup "Init_Not_Enable_or_Engaged"
      No_Engage_1st_with_AccelResSW: SignalBuilderGroup "No_Engage_1st_with_AccelResSW"
      Not_Engaged_with_Enable: SignalBuilderGroup "Not_Engaged_with_Enable"