test file "CruiseControlTests_Coverage"
  coverage: Decision, MCDC, Condition

suite "Functional_Test_Coverage"

  case "SB_Initial_Coverage" [simulation]
    model CruiseControl, harness CruiseControl_Harness_SB, mode Normal
    iterations:
      Init Not Enable or Engaged: SignalBuilderGroup "Init Not Enable or Engaged"
      Not Engaged with Enable: SignalBuilderGroup "Not Engaged with Enable"
      Disengage with Disable: SignalBuilderGroup "Disengage with Disable"
      Engage 1st with CoastSetSW: SignalBuilderGroup "Engage 1st with CoastSetSW"
      No Engage 1st with AccelResSW: SignalBuilderGroup "No Engage 1st with AccelResSW"
      Disengage with Brake: SignalBuilderGroup "Disengage with Brake"
      Re-Engage with CoastSetSw: SignalBuilderGroup "Re-Engage with CoastSetSw"
      Re-Engage with AccelResSw: SignalBuilderGroup "Re-Engage with AccelResSw"
      Engaged Decel with CoastSetSW: SignalBuilderGroup "Engaged Decel with CoastSetSW"
      Engaged Accel with AccelResSW: SignalBuilderGroup "Engaged Accel with AccelResSW"
      Engagd Decel with CoastSet Hold: SignalBuilderGroup "Engagd Decel with CoastSet Hold"
      Engagd Accel with AccelRes Hold: SignalBuilderGroup "Engagd Accel with AccelRes Hold"
      Engage CoastSetSw Veh Spd: SignalBuilderGroup "Engage CoastSetSw Veh Spd"
      Engage AccelResSw Veh Spd: SignalBuilderGroup "Engage AccelResSw Veh Spd"

  case "SB_Full_Coverage" [simulation]
    model CruiseControl, harness CruiseControl_Harness_SB_Full
    iterations:
      Init Not Enable or Engaged: SignalBuilderGroup "Init Not Enable or Engaged"
      Not Engaged with Enable: SignalBuilderGroup "Not Engaged with Enable"
      Disengage with Disable: SignalBuilderGroup "Disengage with Disable"
      Engage 1st with CoastSetSW: SignalBuilderGroup "Engage 1st with CoastSetSW"
      No Engage 1st with AccelResSW: SignalBuilderGroup "No Engage 1st with AccelResSW"
      Disengage with Brake: SignalBuilderGroup "Disengage with Brake"
      Re-Engage with CoastSetSw: SignalBuilderGroup "Re-Engage with CoastSetSw"
      Re-Engage with AccelResSw: SignalBuilderGroup "Re-Engage with AccelResSw"
      Engaged Decel with CoastSetSW: SignalBuilderGroup "Engaged Decel with CoastSetSW"
      Engaged Accel with AccelResSW: SignalBuilderGroup "Engaged Accel with AccelResSW"
      Engagd Decel with CoastSet Hold: SignalBuilderGroup "Engagd Decel with CoastSet Hold"
      Engagd Accel with AccelRes Hold: SignalBuilderGroup "Engagd Accel with AccelRes Hold"
      Engage CoastSetSw Veh Spd: SignalBuilderGroup "Engage CoastSetSw Veh Spd"
      Engage AccelResSw Veh Spd: SignalBuilderGroup "Engage AccelResSw Veh Spd"
      Engage Veh Spd Edge: SignalBuilderGroup "Engage Veh Spd Edge"
      Disengage Veh Spd Edge: SignalBuilderGroup "Disengage Veh Spd Edge"
      Disengage from CoastSet Hold: SignalBuilderGroup "Disengage from CoastSet Hold"
      Disengage from AccelRes Hold: SignalBuilderGroup "Disengage from AccelRes Hold"
      Disengage Veh Spd Edge Hold: SignalBuilderGroup "Disengage Veh Spd Edge Hold"

  case "SB_Full_Coverage_SIL" [simulation]
    model CruiseControl, harness CruiseControl_Harness_SB_Full, mode Software-in-the-Loop (SIL)
    iterations:
      Init Not Enable or Engaged: SignalBuilderGroup "Init Not Enable or Engaged"
      Not Engaged with Enable: SignalBuilderGroup "Not Engaged with Enable"
      Disengage with Disable: SignalBuilderGroup "Disengage with Disable"
      Engage 1st with CoastSetSW: SignalBuilderGroup "Engage 1st with CoastSetSW"
      No Engage 1st with AccelResSW: SignalBuilderGroup "No Engage 1st with AccelResSW"
      Disengage with Brake: SignalBuilderGroup "Disengage with Brake"
      Re-Engage with CoastSetSw: SignalBuilderGroup "Re-Engage with CoastSetSw"
      Re-Engage with AccelResSw: SignalBuilderGroup "Re-Engage with AccelResSw"
      Engaged Decel with CoastSetSW: SignalBuilderGroup "Engaged Decel with CoastSetSW"
      Engaged Accel with AccelResSW: SignalBuilderGroup "Engaged Accel with AccelResSW"
      Engagd Decel with CoastSet Hold: SignalBuilderGroup "Engagd Decel with CoastSet Hold"
      Engagd Accel with AccelRes Hold: SignalBuilderGroup "Engagd Accel with AccelRes Hold"
      Engage CoastSetSw Veh Spd: SignalBuilderGroup "Engage CoastSetSw Veh Spd"
      Engage AccelResSw Veh Spd: SignalBuilderGroup "Engage AccelResSw Veh Spd"
      Engage Veh Spd Edge: SignalBuilderGroup "Engage Veh Spd Edge"
      Disengage Veh Spd Edge: SignalBuilderGroup "Disengage Veh Spd Edge"
      Disengage from CoastSet Hold: SignalBuilderGroup "Disengage from CoastSet Hold"
      Disengage from AccelRes Hold: SignalBuilderGroup "Disengage from AccelRes Hold"
      Disengage Veh Spd Edge Hold: SignalBuilderGroup "Disengage Veh Spd Edge Hold"

  case "Import_XLS_Short_Adaptor" [baseline]
    test data file: CruiseControlTests_SLT_Import.xlsx, adapter XLSadaptor
    model CruiseControl
    parameter set "case01_Init_Not_Enable_or_Engaged_CALS.mat" (off): holdrate = 5, incdec = 1, maxtspeed = 90, mintspeed = 20  % base workspace
    parameter set "case02_Not_Engaged_with_Enable_CALS.mat" (off): holdrate = 5, incdec = 1, maxtspeed = 90, mintspeed = 20  % base workspace
    parameter set "case03_Disengage_with_Disable_CALS.mat" (off): holdrate = 5, incdec = 1, maxtspeed = 90, mintspeed = 20  % base workspace
    parameter set "case04_Engage_1st_with_CoastSetSW_CALS.mat" (off): holdrate = 5, incdec = 1, maxtspeed = 90, mintspeed = 20  % base workspace
    parameter set "case05_No_Engage_1st_with_AccelResSW_CALS.mat" (off): holdrate = 5, incdec = 1, maxtspeed = 90, mintspeed = 20  % base workspace
    parameter set "case06_Disengage_with_Brake_CALS.mat": holdrate = 5, incdec = 1, maxtspeed = 90, mintspeed = 20  % base workspace
    input "case01_Init_Not_Enable_or_Engaged_INPUTS.mat", mapped to CruiseOnOff, Brake, Speed, CoastSetSw, AccelResSw
    input "case02_Not_Engaged_with_Enable_INPUTS.mat", mapped to CruiseOnOff, Brake, Speed, CoastSetSw, AccelResSw
    input "case03_Disengage_with_Disable_INPUTS.mat", mapped to CruiseOnOff, Brake, Speed, CoastSetSw, AccelResSw
    input "case04_Engage_1st_with_CoastSetSW_INPUTS.mat", mapped to CruiseOnOff, Brake, Speed, CoastSetSw, AccelResSw
    input "case05_No_Engage_1st_with_AccelResSW_INPUTS.mat", mapped to CruiseOnOff, Brake, Speed, CoastSetSw, AccelResSw
    input "case06_Disengage_with_Brake_INPUTS.mat", mapped to CruiseOnOff, Brake, Speed, CoastSetSw, AccelResSw (active)
    baseline "case01_Init_Not_Enable_or_Engaged_BASELINE.mat"
      engaged
      tspeed
    baseline "case02_Not_Engaged_with_Enable_BASELINE.mat"
      engaged
      tspeed
    baseline "case03_Disengage_with_Disable_BASELINE.mat"
      engaged
      tspeed
    baseline "case04_Engage_1st_with_CoastSetSW_BASELINE.mat"
      engaged
      tspeed
    baseline "case05_No_Engage_1st_with_AccelResSW_BASELINE.mat"
      engaged
      tspeed
    baseline "case06_Disengage_with_Brake_BASELINE.mat"
      engaged
      tspeed
    iterations:
      case01_Init_Not_Enable_or_Engaged: ExternalInput "case01_Init_Not_Enable_or_Engaged_INPUTS.mat", ParameterSet "case01_Init_Not_Enable_or_Engaged_CALS.mat", Baseline "case01_Init_Not_Enable_or_Engaged_BASELINE.mat"
      case02_Not_Engaged_with_Enable: ExternalInput "case02_Not_Engaged_with_Enable_INPUTS.mat", ParameterSet "case02_Not_Engaged_with_Enable_CALS.mat", Baseline "case02_Not_Engaged_with_Enable_BASELINE.mat"
      case03_Disengage_with_Disable: ExternalInput "case03_Disengage_with_Disable_INPUTS.mat", ParameterSet "case03_Disengage_with_Disable_CALS.mat", Baseline "case03_Disengage_with_Disable_BASELINE.mat"
      case04_Engage_1st_with_CoastSetSW: ExternalInput "case04_Engage_1st_with_CoastSetSW_INPUTS.mat", ParameterSet "case04_Engage_1st_with_CoastSetSW_CALS.mat", Baseline "case04_Engage_1st_with_CoastSetSW_BASELINE.mat"
      case05_No_Engage_1st_with_AccelResSW: ExternalInput "case05_No_Engage_1st_with_AccelResSW_INPUTS.mat", ParameterSet "case05_No_Engage_1st_with_AccelResSW_CALS.mat", Baseline "case05_No_Engage_1st_with_AccelResSW_BASELINE.mat"
      case06_Disengage_with_Brake: ExternalInput "case06_Disengage_with_Brake_INPUTS.mat", ParameterSet "case06_Disengage_with_Brake_CALS.mat", Baseline "case06_Disengage_with_Brake_BASELINE.mat"

  case "SB_Initial_Coverage_Reqs" [simulation]
    model CruiseControl_Req2, harness CruiseControl_Harness_SBAssert_Normal, mode Normal
    iterations:
      Init Not Enable or Engaged: SignalBuilderGroup "Init Not Enable or Engaged"
      Not Engaged with Enable: SignalBuilderGroup "Not Engaged with Enable"
      Disengage with Disable: SignalBuilderGroup "Disengage with Disable"
      Engage 1st with CoastSetSW: SignalBuilderGroup "Engage 1st with CoastSetSW"
      No Engage 1st with AccelResSW: SignalBuilderGroup "No Engage 1st with AccelResSW"
      Disengage with Brake: SignalBuilderGroup "Disengage with Brake"
      Re-Engage with CoastSetSw: SignalBuilderGroup "Re-Engage with CoastSetSw"
      Re-Engage with AccelResSw: SignalBuilderGroup "Re-Engage with AccelResSw"
      Engaged Decel with CoastSetSW: SignalBuilderGroup "Engaged Decel with CoastSetSW"
      Engaged Accel with AccelResSW: SignalBuilderGroup "Engaged Accel with AccelResSW"
      Engagd Decel with CoastSet Hold: SignalBuilderGroup "Engagd Decel with CoastSet Hold"
      Engagd Accel with AccelRes Hold: SignalBuilderGroup "Engagd Accel with AccelRes Hold"
      Engage CoastSetSw Veh Spd: SignalBuilderGroup "Engage CoastSetSw Veh Spd"
      Engage AccelResSw Veh Spd: SignalBuilderGroup "Engage AccelResSw Veh Spd"

  case "Import_XLS_Short_BuiltIn" [baseline]
    model CruiseControl
    parameter set "case01_Init_Not_Enable_or_Engaged_CALS.mat" (off): holdrate = 5, incdec = 1, maxtspeed = 90, mintspeed = 20  % base workspace
    parameter set "case02_Not_Engaged_with_Enable_CALS.mat" (off): holdrate = 5, incdec = 1, maxtspeed = 90, mintspeed = 20  % base workspace
    parameter set "case03_Disengage_with_Disable_CALS.mat" (off): holdrate = 5, incdec = 1, maxtspeed = 90, mintspeed = 20  % base workspace
    parameter set "case04_Engage_1st_with_CoastSetSW_CALS.mat" (off): holdrate = 5, incdec = 1, maxtspeed = 90, mintspeed = 20  % base workspace
    parameter set "case05_No_Engage_1st_with_AccelResSW_CALS.mat" (off): holdrate = 5, incdec = 1, maxtspeed = 90, mintspeed = 20  % base workspace
    parameter set "case06_Disengage_with_Brake_CALS.mat": holdrate = 5, incdec = 1, maxtspeed = 90, mintspeed = 20  % base workspace
    input "CruiseControlTests_SLT_Import_BuiltIn.xlsx", sheet InitNotEnableOrEngaged A:F, mapped to CruiseOnOff, Brake, Speed, CoastSetSw, AccelResSw (active)
    input "CruiseControlTests_SLT_Import_BuiltIn.xlsx (1)" from CruiseControlTests_SLT_Import_BuiltIn.xlsx, sheet NotEngagedWithEnable A:F, mapped to CruiseOnOff, Brake, Speed, CoastSetSw, AccelResSw
    input "CruiseControlTests_SLT_Import_BuiltIn.xlsx (2)" from CruiseControlTests_SLT_Import_BuiltIn.xlsx, sheet DisengageWithDisable A:F, mapped to CruiseOnOff, Brake, Speed, CoastSetSw, AccelResSw
    input "CruiseControlTests_SLT_Import_BuiltIn.xlsx (3)" from CruiseControlTests_SLT_Import_BuiltIn.xlsx, sheet Engage1stWithCoastSetSW A:F, mapped to CruiseOnOff, Brake, Speed, CoastSetSw, AccelResSw
    input "CruiseControlTests_SLT_Import_BuiltIn.xlsx (4)" from CruiseControlTests_SLT_Import_BuiltIn.xlsx, sheet NoEngage1stWithAccelResSW A:F, mapped to CruiseOnOff, Brake, Speed, CoastSetSw, AccelResSw
    input "CruiseControlTests_SLT_Import_BuiltIn.xlsx (5)" from CruiseControlTests_SLT_Import_BuiltIn.xlsx, sheet DisengageWithBrake A:F, mapped to CruiseOnOff, Brake, Speed, CoastSetSw, AccelResSw
    logged signals "Signal Set 1": ComputeTargetSpeed:1, ComputeTargetSpeed:2
    baseline "CruiseControlTests_SLT_Import_BuiltIn.xlsx"
      engaged
      tspeed
    baseline "CruiseControlTests_SLT_Import_BuiltIn.xlsx (1)"
      engaged
      tspeed
    baseline "CruiseControlTests_SLT_Import_BuiltIn.xlsx (2)"
      engaged
      tspeed
    baseline "CruiseControlTests_SLT_Import_BuiltIn.xlsx (3)"
      engaged
      tspeed
    baseline "CruiseControlTests_SLT_Import_BuiltIn.xlsx (4)"
      engaged
      tspeed
    baseline "CruiseControlTests_SLT_Import_BuiltIn.xlsx (5)"
      engaged
      tspeed
    iterations:
      Iteration1: ExternalInput "CruiseControlTests_SLT_Import_BuiltIn.xlsx", Baseline "CruiseControlTests_SLT_Import_BuiltIn.xlsx"
      Iteration2: ExternalInput "CruiseControlTests_SLT_Import_BuiltIn.xlsx (1)", Baseline "CruiseControlTests_SLT_Import_BuiltIn.xlsx (1)"
      Iteration3: ExternalInput "CruiseControlTests_SLT_Import_BuiltIn.xlsx (2)", Baseline "CruiseControlTests_SLT_Import_BuiltIn.xlsx (2)"
      Iteration4: ExternalInput "CruiseControlTests_SLT_Import_BuiltIn.xlsx (3)", Baseline "CruiseControlTests_SLT_Import_BuiltIn.xlsx (3)"
      Iteration5: ExternalInput "CruiseControlTests_SLT_Import_BuiltIn.xlsx (4)", Baseline "CruiseControlTests_SLT_Import_BuiltIn.xlsx (4)"
      Iteration6: ExternalInput "CruiseControlTests_SLT_Import_BuiltIn.xlsx (5)", Baseline "CruiseControlTests_SLT_Import_BuiltIn.xlsx (5)"

suite "Equivalence_Test"

  case "SB_Equiv_Full_Cov_ReqsBased" [equivalence]
    simulation 1:
      model CruiseControl, harness CruiseControl_Harness_SB_Full
    simulation 2:
      model CruiseControl_SIL, harness CruiseControl_Harness_SB_Full_SIL
    equivalence criteria
      engaged
      tspeed
      Exp_engaged
      Exp_tspeed
      AccelResSw
      Brake
      CoastSetSw
      CruiseOnOff
      Speed
      engaged_Assertion
      tspeed_Assertion
    custom criteria (off):
      % Return value: customCriteria
      % set customCriteria.out to true for pass and false for fail
      % set customCriteria.logs (cell array) for log messages
      % set customCriteria.errors (cell array) for error messages

      customCriteria.out = true;
    iteration script:
      %% Iterate over all Signal Builder Groups.

      % Determine the number of possible iterations
      numSteps = min(length(sltest_signalBuilderGroups{1}), length(sltest_signalBuilderGroups{2}));

      % Create each iteration
      for k = 1 : numSteps
          % Set up a new iteration object
          testItr = sltestiteration();

          % Set iteration settings
          setTestParam(testItr, 'SignalBuilderGroup', sltest_signalBuilderGroups{1}{k}, 'SimulationIndex', 1);
          setTestParam(testItr, 'SignalBuilderGroup', sltest_signalBuilderGroups{2}{k}, 'SimulationIndex', 2);

          % Register the iteration to run in this test case
          %    use SB group name for iteration name
          addIteration(sltest_testCase, testItr,sltest_signalBuilderGroups{1}{k});
      end

  case "SB_Equiv_Full_Cov_SLDV" [equivalence]
    simulation 1:
      model CruiseControl, harness CruiseControl_Harness_SB_SLDV
    simulation 2:
      model CruiseControl_SIL, harness CruiseControl_Harness_SB_SLDV_SIL
    equivalence criteria
      engaged
      tspeed
      Exp_engaged
      Exp_tspeed
      AccelResSw
      Brake
      CoastSetSw
      CruiseOnOff
      Speed
      engaged_Assertion
      tspeed_Assertion
    custom criteria (off): same code as in custom criteria (off) of case "SB_Equiv_Full_Cov_ReqsBased"
    iteration script: same code as in iteration script of case "SB_Equiv_Full_Cov_ReqsBased"

  case "SB_SIL_Full_Cov_ReqsBased" [baseline]
    model CruiseControl_SIL, harness CruiseControl_Harness_SB_Full_SIL
    baseline "assertBaseline.mat"
      tspeed_Assertion
      engaged_Assertion
    custom criteria (off): same code as in custom criteria (off) of case "SB_Equiv_Full_Cov_ReqsBased"
    iteration script:
      %% Iterate over all Signal Builder Groups.

      % Determine the number of possible iterations
      numSteps = length(sltest_signalBuilderGroups);

      % Create each iteration
      for k = 1 : numSteps
          % Set up a new iteration object
          testItr = sltestiteration();

          % Set iteration settings
          setTestParam(testItr, 'SignalBuilderGroup', sltest_signalBuilderGroups{k});

          % Register the iteration to run in this test case
          addIteration(sltest_testCase, testItr, sltest_signalBuilderGroups{k}); % You can pass in an optional iteration name
      end

  case "SB_Equiv_Full_Cov" [equivalence]
    simulation 1:
      model CruiseControl, harness CruiseControl_Harness_SB_Full
    simulation 2:
      model CruiseControl, harness CruiseControl_Harness_SB_Full, mode Software-in-the-Loop (SIL)
    equivalence criteria (2 of 9 signals compared)
      engaged
      tspeed
    custom criteria (off): same code as in custom criteria (off) of case "SB_Equiv_Full_Cov_ReqsBased"
    iteration script: same code as in iteration script of case "SB_Equiv_Full_Cov_ReqsBased"

suite "Dev"

  suite "Standalone_Harness"

    case "SB_Full_SIL" [baseline]
      model CruiseControl_StandaloneHarness_SB_Full_SIL
      baseline "assertBaseline.mat"
        tspeed_Assertion
        engaged_Assertion
      custom criteria (off): same code as in custom criteria (off) of case "SB_Equiv_Full_Cov_ReqsBased"
      iteration script:
        %% Iterate over all Signal Builder Groups.

        % Determine the number of possible iterations
        numSteps = length(sltest_signalBuilderGroups);

        % Create each iteration
        for k = 1 : numSteps
            % Set up a new iteration object
            testItr = sltestiteration();

            % Set iteration settings
            setTestParam(testItr, 'SignalBuilderGroup', sltest_signalBuilderGroups{k});

            % Register the iteration to run in this test case
            addIteration(sltest_testCase, testItr, sltest_signalBuilderGroups{k});
        end

    case "SB_Full_SIL_SimTest" [simulation]
      model CruiseControl_StandaloneHarness_SB_Full_SIL
      signal scenario: Init Not Enable or Engaged (CruiseControl_Harness_SB_Full_SIL/Harness Inputs)
      custom criteria (off): same code as in custom criteria (off) of case "SB_Equiv_Full_Cov_ReqsBased"

  suite "Equivalence_Test"

    case "SB_Equiv_Full_Coverage_Iterations" [equivalence]
      simulation 1:
        model CruiseControl, harness CruiseControl_Harness_SB_Full
      simulation 2:
        model CruiseControl, harness CruiseControl_Harness_SB_Full
      equivalence criteria
        engaged
        tspeed
        Exp_engaged
        Exp_tspeed
        AccelResSw
        Brake
        CoastSetSw
        CruiseOnOff
        Speed
        engaged_Assertion
        tspeed_Assertion
      custom criteria (off): same code as in custom criteria (off) of case "SB_Equiv_Full_Cov_ReqsBased"
      iteration script: same code as in iteration script of case "SB_Equiv_Full_Cov_ReqsBased"

    case "SB_Equiv_Full_Coverage_SIL_Harness" [equivalence]
      simulation 1:
        model CruiseControl, harness CruiseControl_Harness_SB_Full
      simulation 2:
        model CruiseControl, harness CruiseControl_Harness_SB_Full_SIL
      equivalence criteria
        engaged
        tspeed
        Exp_engaged
        Exp_tspeed
        AccelResSw
        Brake
        CoastSetSw
        CruiseOnOff
        Speed
        engaged_Assertion
        tspeed_Assertion
      custom criteria (off): same code as in custom criteria (off) of case "SB_Equiv_Full_Cov_ReqsBased"
      iteration script: same code as in iteration script of case "SB_Equiv_Full_Cov_ReqsBased"

    case "SB_Equiv_Full_Coverage_SIL_StandaloneHarness" [equivalence]
      simulation 1:
        model CruiseControl, harness CruiseControl_Harness_SB_Full
      simulation 2:
        model CruiseControl_StandaloneHarness_SB_Full_SIL
      equivalence criteria
        engaged
        tspeed
        Exp_engaged
        Exp_tspeed
        AccelResSw
        Brake
        CoastSetSw
        CruiseOnOff
        Speed
        engaged_Assertion
        tspeed_Assertion
      custom criteria (off): same code as in custom criteria (off) of case "SB_Equiv_Full_Cov_ReqsBased"
      iteration script: same code as in iteration script of case "SB_Equiv_Full_Cov_ReqsBased"

    case "SB_Equiv_Full_Coverage_SIL_Block_StandaloneHarness" [equivalence]
      simulation 1:
        model CruiseControl, harness CruiseControl_Harness_SB_Full
      simulation 2:
        model CruiseControl_StandaloneHarness_SB_Full_SIL_Block
      equivalence criteria
        engaged
        tspeed
        Exp_engaged
        Exp_tspeed
        AccelResSw
        Brake
        CoastSetSw
        CruiseOnOff
        Speed
        engaged_Assertion
        tspeed_Assertion
      custom criteria (off): same code as in custom criteria (off) of case "SB_Equiv_Full_Cov_ReqsBased"
      iteration script: same code as in iteration script of case "SB_Equiv_Full_Cov_ReqsBased"

    suite "SB_Full_Equivalence"

      case "Init Not Enable or Engaged" [equivalence]
        simulation 1:
          model CruiseControl, harness CruiseControl_Harness_SB_Full
          signal scenario: Init Not Enable or Engaged
        simulation 2:
          model CruiseControl, harness CruiseControl_Harness_SB_Full
          signal scenario: Init Not Enable or Engaged
        equivalence criteria
          engaged
          tspeed
          Exp_engaged
          Exp_tspeed
          AccelResSw
          Brake
          CoastSetSw
          CruiseOnOff
          Speed
          engaged_Assertion
          tspeed_Assertion
        custom criteria (off): same code as in custom criteria (off) of case "SB_Equiv_Full_Cov_ReqsBased"

      case "Not Engaged with Enable" [equivalence]
        simulation 1:
          model CruiseControl, harness CruiseControl_Harness_SB_Full
          signal scenario: Not Engaged with Enable
        simulation 2:
          model CruiseControl, harness CruiseControl_Harness_SB_Full
          signal scenario: Not Engaged with Enable
        equivalence criteria
          engaged
          tspeed
          Exp_engaged
          Exp_tspeed
          AccelResSw
          Brake
          CoastSetSw
          CruiseOnOff
          Speed
          engaged_Assertion
          tspeed_Assertion
        custom criteria (off): same code as in custom criteria (off) of case "SB_Equiv_Full_Cov_ReqsBased"

      case "Disengage with Disable" [equivalence]
        simulation 1:
          model CruiseControl, harness CruiseControl_Harness_SB_Full
          signal scenario: Disengage with Disable
        simulation 2:
          model CruiseControl, harness CruiseControl_Harness_SB_Full
          signal scenario: Disengage with Disable
        equivalence criteria
          engaged
          tspeed
          Exp_engaged
          Exp_tspeed
          AccelResSw
          Brake
          CoastSetSw
          CruiseOnOff
          Speed
          engaged_Assertion
          tspeed_Assertion
        custom criteria (off): same code as in custom criteria (off) of case "SB_Equiv_Full_Cov_ReqsBased"

      case "Engage 1st with CoastSetSW" [equivalence]
        simulation 1:
          model CruiseControl, harness CruiseControl_Harness_SB_Full
          signal scenario: Engage 1st with CoastSetSW
        simulation 2:
          model CruiseControl, harness CruiseControl_Harness_SB_Full
          signal scenario: Engage 1st with CoastSetSW
        equivalence criteria
          engaged
          tspeed
          Exp_engaged
          Exp_tspeed
          AccelResSw
          Brake
          CoastSetSw
          CruiseOnOff
          Speed
          engaged_Assertion
          tspeed_Assertion
        custom criteria (off): same code as in custom criteria (off) of case "SB_Equiv_Full_Cov_ReqsBased"

      case "No Engage 1st with AccelResSW" [equivalence]
        simulation 1:
          model CruiseControl, harness CruiseControl_Harness_SB_Full
          signal scenario: No Engage 1st with AccelResSW
        simulation 2:
          model CruiseControl, harness CruiseControl_Harness_SB_Full
          signal scenario: No Engage 1st with AccelResSW
        equivalence criteria
          engaged
          tspeed
          Exp_engaged
          Exp_tspeed
          AccelResSw
          Brake
          CoastSetSw
          CruiseOnOff
          Speed
          engaged_Assertion
          tspeed_Assertion
        custom criteria (off): same code as in custom criteria (off) of case "SB_Equiv_Full_Cov_ReqsBased"

      case "Disengage with Brake" [equivalence]
        simulation 1:
          model CruiseControl, harness CruiseControl_Harness_SB_Full
          signal scenario: Disengage with Brake
        simulation 2:
          model CruiseControl, harness CruiseControl_Harness_SB_Full
          signal scenario: Disengage with Brake
        equivalence criteria
          engaged
          tspeed
          Exp_engaged
          Exp_tspeed
          AccelResSw
          Brake
          CoastSetSw
          CruiseOnOff
          Speed
          engaged_Assertion
          tspeed_Assertion
        custom criteria (off): same code as in custom criteria (off) of case "SB_Equiv_Full_Cov_ReqsBased"

      case "Re-Engage with CoastSetSw" [equivalence]
        simulation 1:
          model CruiseControl, harness CruiseControl_Harness_SB_Full
          signal scenario: Re-Engage with CoastSetSw
        simulation 2:
          model CruiseControl, harness CruiseControl_Harness_SB_Full
          signal scenario: Re-Engage with CoastSetSw
        equivalence criteria
          engaged
          tspeed
          Exp_engaged
          Exp_tspeed
          AccelResSw
          Brake
          CoastSetSw
          CruiseOnOff
          Speed
          engaged_Assertion
          tspeed_Assertion
        custom criteria (off): same code as in custom criteria (off) of case "SB_Equiv_Full_Cov_ReqsBased"

      case "Re-Engage with AccelResSw" [equivalence]
        simulation 1:
          model CruiseControl, harness CruiseControl_Harness_SB_Full
          signal scenario: Re-Engage with AccelResSw
        simulation 2:
          model CruiseControl, harness CruiseControl_Harness_SB_Full
          signal scenario: Re-Engage with AccelResSw
        equivalence criteria
          engaged
          tspeed
          Exp_engaged
          Exp_tspeed
          AccelResSw
          Brake
          CoastSetSw
          CruiseOnOff
          Speed
          engaged_Assertion
          tspeed_Assertion
        custom criteria (off): same code as in custom criteria (off) of case "SB_Equiv_Full_Cov_ReqsBased"

      case "Engaged Decel with CoastSetSW" [equivalence]
        simulation 1:
          model CruiseControl, harness CruiseControl_Harness_SB_Full
          signal scenario: Engaged Decel with CoastSetSW
        simulation 2:
          model CruiseControl, harness CruiseControl_Harness_SB_Full
          signal scenario: Engaged Decel with CoastSetSW
        equivalence criteria
          engaged
          tspeed
          Exp_engaged
          Exp_tspeed
          AccelResSw
          Brake
          CoastSetSw
          CruiseOnOff
          Speed
          engaged_Assertion
          tspeed_Assertion
        custom criteria (off): same code as in custom criteria (off) of case "SB_Equiv_Full_Cov_ReqsBased"

      case "Engaged Accel with AccelResSW" [equivalence]
        simulation 1:
          model CruiseControl, harness CruiseControl_Harness_SB_Full
          signal scenario: Engaged Accel with AccelResSW
        simulation 2:
          model CruiseControl, harness CruiseControl_Harness_SB_Full
          signal scenario: Engaged Accel with AccelResSW
        equivalence criteria
          engaged
          tspeed
          Exp_engaged
          Exp_tspeed
          AccelResSw
          Brake
          CoastSetSw
          CruiseOnOff
          Speed
          engaged_Assertion
          tspeed_Assertion
        custom criteria (off): same code as in custom criteria (off) of case "SB_Equiv_Full_Cov_ReqsBased"

      case "Engagd Decel with CoastSet Hold" [equivalence]
        simulation 1:
          model CruiseControl, harness CruiseControl_Harness_SB_Full
          signal scenario: Engagd Decel with CoastSet Hold
        simulation 2:
          model CruiseControl, harness CruiseControl_Harness_SB_Full
          signal scenario: Engagd Decel with CoastSet Hold
        equivalence criteria
          engaged
          tspeed
          Exp_engaged
          Exp_tspeed
          AccelResSw
          Brake
          CoastSetSw
          CruiseOnOff
          Speed
          engaged_Assertion
          tspeed_Assertion
        custom criteria (off): same code as in custom criteria (off) of case "SB_Equiv_Full_Cov_ReqsBased"

      case "Engagd Accel with AccelRes Hold" [equivalence]
        simulation 1:
          model CruiseControl, harness CruiseControl_Harness_SB_Full
          signal scenario: Engagd Accel with AccelRes Hold
        simulation 2:
          model CruiseControl, harness CruiseControl_Harness_SB_Full
          signal scenario: Engagd Accel with AccelRes Hold
        equivalence criteria
          engaged
          tspeed
          Exp_engaged
          Exp_tspeed
          AccelResSw
          Brake
          CoastSetSw
          CruiseOnOff
          Speed
          engaged_Assertion
          tspeed_Assertion
        custom criteria (off): same code as in custom criteria (off) of case "SB_Equiv_Full_Cov_ReqsBased"

      case "Engage CoastSetSw Veh Spd" [equivalence]
        simulation 1:
          model CruiseControl, harness CruiseControl_Harness_SB_Full
          signal scenario: Engage CoastSetSw Veh Spd
        simulation 2:
          model CruiseControl, harness CruiseControl_Harness_SB_Full
          signal scenario: Engage CoastSetSw Veh Spd
        equivalence criteria
          engaged
          tspeed
          Exp_engaged
          Exp_tspeed
          AccelResSw
          Brake
          CoastSetSw
          CruiseOnOff
          Speed
          engaged_Assertion
          tspeed_Assertion
        custom criteria (off): same code as in custom criteria (off) of case "SB_Equiv_Full_Cov_ReqsBased"

      case "Engage AccelResSw Veh Spd" [equivalence]
        simulation 1:
          model CruiseControl, harness CruiseControl_Harness_SB_Full
          signal scenario: Engage AccelResSw Veh Spd
        simulation 2:
          model CruiseControl, harness CruiseControl_Harness_SB_Full
          signal scenario: Engage AccelResSw Veh Spd
        equivalence criteria
          engaged
          tspeed
          Exp_engaged
          Exp_tspeed
          AccelResSw
          Brake
          CoastSetSw
          CruiseOnOff
          Speed
          engaged_Assertion
          tspeed_Assertion
        custom criteria (off): same code as in custom criteria (off) of case "SB_Equiv_Full_Cov_ReqsBased"

      case "Engage Veh Spd Edge" [equivalence]
        simulation 1:
          model CruiseControl, harness CruiseControl_Harness_SB_Full
          signal scenario: Engage Veh Spd Edge
        simulation 2:
          model CruiseControl, harness CruiseControl_Harness_SB_Full
          signal scenario: Engage Veh Spd Edge
        equivalence criteria
          engaged
          tspeed
          Exp_engaged
          Exp_tspeed
          AccelResSw
          Brake
          CoastSetSw
          CruiseOnOff
          Speed
          engaged_Assertion
          tspeed_Assertion
        custom criteria (off): same code as in custom criteria (off) of case "SB_Equiv_Full_Cov_ReqsBased"

      case "Disengage Veh Spd Edge" [equivalence]
        simulation 1:
          model CruiseControl, harness CruiseControl_Harness_SB_Full
          signal scenario: Disengage Veh Spd Edge
        simulation 2:
          model CruiseControl, harness CruiseControl_Harness_SB_Full
          signal scenario: Disengage Veh Spd Edge
        equivalence criteria
          engaged
          tspeed
          Exp_engaged
          Exp_tspeed
          AccelResSw
          Brake
          CoastSetSw
          CruiseOnOff
          Speed
          engaged_Assertion
          tspeed_Assertion
        custom criteria (off): same code as in custom criteria (off) of case "SB_Equiv_Full_Cov_ReqsBased"

      case "Disengage from CoastSet Hold" [equivalence]
        simulation 1:
          model CruiseControl, harness CruiseControl_Harness_SB_Full
          signal scenario: Disengage from CoastSet Hold
        simulation 2:
          model CruiseControl, harness CruiseControl_Harness_SB_Full
          signal scenario: Disengage from CoastSet Hold
        equivalence criteria
          engaged
          tspeed
          Exp_engaged
          Exp_tspeed
          AccelResSw
          Brake
          CoastSetSw
          CruiseOnOff
          Speed
          engaged_Assertion
          tspeed_Assertion
        custom criteria (off): same code as in custom criteria (off) of case "SB_Equiv_Full_Cov_ReqsBased"

      case "Disengage from AccelRes Hold" [equivalence]
        simulation 1:
          model CruiseControl, harness CruiseControl_Harness_SB_Full
          signal scenario: Disengage from AccelRes Hold
        simulation 2:
          model CruiseControl, harness CruiseControl_Harness_SB_Full
          signal scenario: Disengage from AccelRes Hold
        equivalence criteria
          engaged
          tspeed
          Exp_engaged
          Exp_tspeed
          AccelResSw
          Brake
          CoastSetSw
          CruiseOnOff
          Speed
          engaged_Assertion
          tspeed_Assertion
        custom criteria (off): same code as in custom criteria (off) of case "SB_Equiv_Full_Cov_ReqsBased"

      case "Disengage Veh Spd Edge Hold" [equivalence]
        simulation 1:
          model CruiseControl, harness CruiseControl_Harness_SB_Full
          signal scenario: Disengage Veh Spd Edge Hold
        simulation 2:
          model CruiseControl, harness CruiseControl_Harness_SB_Full
          signal scenario: Disengage Veh Spd Edge Hold
        equivalence criteria
          engaged
          tspeed
          Exp_engaged
          Exp_tspeed
          AccelResSw
          Brake
          CoastSetSw
          CruiseOnOff
          Speed
          engaged_Assertion
          tspeed_Assertion
        custom criteria (off): same code as in custom criteria (off) of case "SB_Equiv_Full_Cov_ReqsBased"

suite "SIL_Test"

  case "SB_Full_Coverage_SLDV" [baseline]
    model CruiseControl_SIL, harness CruiseControl_Harness_SB_SLDV_SIL
    baseline "assertBaseline.mat"
      tspeed_Assertion
      engaged_Assertion
    custom criteria (off): same code as in custom criteria (off) of case "SB_Equiv_Full_Cov_ReqsBased"
    iteration script:
      %% Iterate over all Signal Builder Groups.

      % Determine the number of possible iterations
      numSteps = length(sltest_signalBuilderGroups);

      % Create each iteration
      for k = 1 : numSteps
          % Set up a new iteration object
          testItr = sltestiteration();

          % Set iteration settings
          setTestParam(testItr, 'SignalBuilderGroup', sltest_signalBuilderGroups{k});

          % Register the iteration to run in this test case
          addIteration(sltest_testCase, testItr,sltest_signalBuilderGroups{k}); % You can pass in an optional iteration name
      end