test file "CruiseControlTests_More"
  coverage: Decision, MCDC, Condition

suite "Test Suite"

  case "Import_XLS_Short_Adapter" [baseline]
    test data file: CruiseControlTests_ImportAdapter.xlsx, adapter XLSadaptor
    model CruiseControl
    parameter set "case_01_Init_Not_Enable_or_Engaged_CALS.mat" (off): holdrate = 5, incdec = 1, maxtspeed = 90, mintspeed = 20
    parameter set "case_02_Not_Engaged_with_Enable_CALS.mat" (off): holdrate = 5, incdec = 1, maxtspeed = 90, mintspeed = 20
    parameter set "case_03_Disengage_with_Disable_CALS.mat" (off): holdrate = 5, incdec = 1, maxtspeed = 90, mintspeed = 20
    parameter set "case_04_Engage_1st_with_CoastSetSW_CALS.mat" (off): holdrate = 5, incdec = 1, maxtspeed = 90, mintspeed = 20
    parameter set "case_05_No_Engage_1st_with_AccelResSW_CALS.mat" (off): holdrate = 5, incdec = 1, maxtspeed = 90, mintspeed = 20
    parameter set "case_06_Disengage_with_Brake_CALS.mat": holdrate = 5, incdec = 1, maxtspeed = 90, mintspeed = 20
    input "case_01_Init_Not_Enable_or_Engaged_INPUTS.mat", mapped to CruiseOnOff, Brake, Speed, CoastSetSw, AccelResSw
    input "case_02_Not_Engaged_with_Enable_INPUTS.mat", mapped to CruiseOnOff, Brake, Speed, CoastSetSw, AccelResSw
    input "case_03_Disengage_with_Disable_INPUTS.mat", mapped to CruiseOnOff, Brake, Speed, CoastSetSw, AccelResSw
    input "case_04_Engage_1st_with_CoastSetSW_INPUTS.mat", mapped to CruiseOnOff, Brake, Speed, CoastSetSw, AccelResSw
    input "case_05_No_Engage_1st_with_AccelResSW_INPUTS.mat", mapped to CruiseOnOff, Brake, Speed, CoastSetSw, AccelResSw
    input "case_06_Disengage_with_Brake_INPUTS.mat", mapped to CruiseOnOff, Brake, Speed, CoastSetSw, AccelResSw (active)
    baseline "case_01_Init_Not_Enable_or_Engaged_BASELINE.mat"
      engaged
      tspeed
    baseline "case_02_Not_Engaged_with_Enable_BASELINE.mat"
      engaged
      tspeed
    baseline "case_03_Disengage_with_Disable_BASELINE.mat"
      engaged
      tspeed
    baseline "case_04_Engage_1st_with_CoastSetSW_BASELINE.mat"
      engaged
      tspeed
    baseline "case_05_No_Engage_1st_with_AccelResSW_BASELINE.mat"
      engaged
      tspeed
    baseline "case_06_Disengage_with_Brake_BASELINE.mat"
      engaged
      tspeed
    iterations:
      case_01_Init_Not_Enable_or_Engaged: ExternalInput "case_01_Init_Not_Enable_or_Engaged_INPUTS.mat", ParameterSet "case_01_Init_Not_Enable_or_Engaged_CALS.mat", Baseline "case_01_Init_Not_Enable_or_Engaged_BASELINE.mat"
      case_02_Not_Engaged_with_Enable: ExternalInput "case_02_Not_Engaged_with_Enable_INPUTS.mat", ParameterSet "case_02_Not_Engaged_with_Enable_CALS.mat", Baseline "case_02_Not_Engaged_with_Enable_BASELINE.mat"
      case_03_Disengage_with_Disable: ExternalInput "case_03_Disengage_with_Disable_INPUTS.mat", ParameterSet "case_03_Disengage_with_Disable_CALS.mat", Baseline "case_03_Disengage_with_Disable_BASELINE.mat"
      case_04_Engage_1st_with_CoastSetSW: ExternalInput "case_04_Engage_1st_with_CoastSetSW_INPUTS.mat", ParameterSet "case_04_Engage_1st_with_CoastSetSW_CALS.mat", Baseline "case_04_Engage_1st_with_CoastSetSW_BASELINE.mat"
      case_05_No_Engage_1st_with_AccelResSW: ExternalInput "case_05_No_Engage_1st_with_AccelResSW_INPUTS.mat", ParameterSet "case_05_No_Engage_1st_with_AccelResSW_CALS.mat", Baseline "case_05_No_Engage_1st_with_AccelResSW_BASELINE.mat"
      case_06_Disengage_with_Brake: ExternalInput "case_06_Disengage_with_Brake_INPUTS.mat", ParameterSet "case_06_Disengage_with_Brake_CALS.mat", Baseline "case_06_Disengage_with_Brake_BASELINE.mat"

  case "Import_XLS_Short_BuiltIn" [baseline]
    model CruiseControl
    input "CruiseControlTests_Import_BuiltIn.xlsx", sheet InitNotEnableOrEngaged A:F, mapped to CruiseOnOff, Brake, Speed, CoastSetSw, AccelResSw (active)
    input "CruiseControlTests_Import_BuiltIn.xlsx (1)" from CruiseControlTests_Import_BuiltIn.xlsx, sheet NotEngagedWithEnable A:F, mapped to CruiseOnOff, Brake, Speed, CoastSetSw, AccelResSw
    input "CruiseControlTests_Import_BuiltIn.xlsx (2)" from CruiseControlTests_Import_BuiltIn.xlsx, sheet DisengageWithDisable A:F, mapped to CruiseOnOff, Brake, Speed, CoastSetSw, AccelResSw
    input "CruiseControlTests_Import_BuiltIn.xlsx (3)" from CruiseControlTests_Import_BuiltIn.xlsx, sheet Engage1stWithCoastSetSW A:F, mapped to CruiseOnOff, Brake, Speed, CoastSetSw, AccelResSw
    input "CruiseControlTests_Import_BuiltIn.xlsx (4)" from CruiseControlTests_Import_BuiltIn.xlsx, sheet NoEngage1stWithAccelResSW A:F, mapped to CruiseOnOff, Brake, Speed, CoastSetSw, AccelResSw
    input "CruiseControlTests_Import_BuiltIn.xlsx (5)" from CruiseControlTests_Import_BuiltIn.xlsx, sheet DisengageWithBrake A:F, mapped to CruiseOnOff, Brake, Speed, CoastSetSw, AccelResSw
    logged signals "Signal Set 1": ComputeTargetSpeed:1, ComputeTargetSpeed:2
    baseline "CruiseControlTests_Import_BuiltIn.xlsx"
      engaged
      tspeed
    baseline "CruiseControlTests_Import_BuiltIn.xlsx (1)"
      engaged
      tspeed
    baseline "CruiseControlTests_Import_BuiltIn.xlsx (2)"
      engaged
      tspeed
    baseline "CruiseControlTests_Import_BuiltIn.xlsx (3)"
      engaged
      tspeed
    baseline "CruiseControlTests_Import_BuiltIn.xlsx (4)"
      engaged
      tspeed
    baseline "CruiseControlTests_Import_BuiltIn.xlsx (5)"
      engaged
      tspeed
    iterations:
      Iteration1: ExternalInput "CruiseControlTests_Import_BuiltIn.xlsx", Baseline "CruiseControlTests_Import_BuiltIn.xlsx"
      Iteration2: ExternalInput "CruiseControlTests_Import_BuiltIn.xlsx (1)", Baseline "CruiseControlTests_Import_BuiltIn.xlsx (1)"
      Iteration3: ExternalInput "CruiseControlTests_Import_BuiltIn.xlsx (2)", Baseline "CruiseControlTests_Import_BuiltIn.xlsx (2)"
      Iteration4: ExternalInput "CruiseControlTests_Import_BuiltIn.xlsx (3)", Baseline "CruiseControlTests_Import_BuiltIn.xlsx (3)"
      Iteration5: ExternalInput "CruiseControlTests_Import_BuiltIn.xlsx (4)", Baseline "CruiseControlTests_Import_BuiltIn.xlsx (4)"
      Iteration6: ExternalInput "CruiseControlTests_Import_BuiltIn.xlsx (5)", Baseline "CruiseControlTests_Import_BuiltIn.xlsx (5)"

  case "SigEditorBlock_Short_BuiltIn" [simulation]
    model CruiseControl, harness CruiseControl_Harness_SigEditor
    iterations:
      Disengage_with_Brake: SignalBuilderGroup "Disengage_with_Brake"
      Disengage_with_Disable: SignalBuilderGroup "Disengage_with_Disable"
      Engage_1st_with_CoastSetSW: SignalBuilderGroup "Engage_1st_with_CoastSetSW"
      Init_Not_Enable_or_Engaged: SignalBuilderGroup "Init_Not_Enable_or_Engaged"
      No_Engage_1st_with_AccelResSW: SignalBuilderGroup "No_Engage_1st_with_AccelResSW"
      Not_Engaged_with_Enable: SignalBuilderGroup "Not_Engaged_with_Enable"

suite "Misc"

  case "SigEditorBlock_Short_Adapter" [simulation]
    test data file: CruiseControl_Short_SigEditor.mat, adapter sigEditorBlkAdapter
    model CruiseControl, harness CruiseControl_Harness_SigEditor
    post-load callback:
      set_param('CruiseControl_Harness_SigEditor/TestCases','ActiveScenario',sltest_iterationName);
    iterations:
      case_01_Disengage_with_Brake
      case_02_Disengage_with_Disable
      case_03_Engage_1st_with_CoastSetSW
      case_04_Init_Not_Enable_or_Engaged
      case_05_No_Engage_1st_with_AccelResSW
      case_06_Not_Engaged_with_Enable

  case "Temporal Assessment" [baseline]
    model CruiseControl
    input "DisengageWithBrake" from CruiseControlTests_Import_Auto_TA.xlsx, mapped to CruiseOnOff, Brake, Speed, CoastSetSw, AccelResSw (active)
    input "DisengageVehSpdEdgeHold" from CruiseControlTests_Import_Auto_TA.xlsx, mapped to CruiseOnOff, Brake, Speed, CoastSetSw, AccelResSw
    logged signals "Signal Set 1": engaged, tspeed, AccelResSw, Speed, CoastSetSw, Brake, CruiseOnOff
    baseline "DisengageWithBrake"
      engaged
      tspeed
    baseline "DisengageVehSpdEdgeHold"
      engaged
      tspeed
    assessment "DisengageWithBrake": At any point of time, if brake becomes true then, with no delay, ~engaged must be true
    assessment "LimitTargetSpeed": At any point of time, tspeed must be greater than or equal to uint8(20) and less than or equal to uint8(90)
    assessment "LimitTargetSpeedTrig": At any point of time, whenever engaged is true then, with no delay, tspeed>=mintspeed & tspeed<=maxtspeed must be true
      engaged: signal CruiseControl/ComputeTargetSpeed, port 1
      brake: signal CruiseControl/Brake, port 1
      tspeed: signal CruiseControl/ComputeTargetSpeed, port 2
      mintspeed: variable CruiseControl/ComputeTargetSpeed
      maxtspeed: variable CruiseControl/ComputeTargetSpeed
    iterations:
      DisengageWithBrake: ExternalInput "DisengageWithBrake", Assessments "[\"DisengageWithBrake\"]", Baseline "DisengageWithBrake"
      DisengageVehSpdEdgeHold: ExternalInput "DisengageVehSpdEdgeHold", Assessments "[\"LimitTargetSpeedTrig\"]", Baseline "DisengageVehSpdEdgeHold"

  case "Import_XLS_Auto" [baseline]
    test data file: CruiseControlTests_Import_Auto.xlsx
    model CruiseControl
    input "InitNotEnableOrEngaged" from CruiseControlTests_Import_Auto.xlsx, mapped to CruiseOnOff, Brake, Speed, CoastSetSw, AccelResSw
    input "NotEngagedWithEnable" from CruiseControlTests_Import_Auto.xlsx, mapped to CruiseOnOff, Brake, Speed, CoastSetSw, AccelResSw
    input "DisengageWithDisable" from CruiseControlTests_Import_Auto.xlsx, mapped to CruiseOnOff, Brake, Speed, CoastSetSw, AccelResSw
    input "Engage1stWithCoastSetSW" from CruiseControlTests_Import_Auto.xlsx, mapped to CruiseOnOff, Brake, Speed, CoastSetSw, AccelResSw
    input "NoEngage1stWithAccelResSW" from CruiseControlTests_Import_Auto.xlsx, mapped to CruiseOnOff, Brake, Speed, CoastSetSw, AccelResSw
    input "DisengageWithBrake" from CruiseControlTests_Import_Auto.xlsx, mapped to CruiseOnOff, Brake, Speed, CoastSetSw, AccelResSw
    baseline "InitNotEnableOrEngaged"
      CruiseOnOff
      Brake
      Speed
      CoastSetSw
      AccelResSw
      engaged
      tspeed
    baseline "NotEngagedWithEnable"
      CruiseOnOff
      Brake
      Speed
      CoastSetSw
      AccelResSw
      engaged
      tspeed
    baseline "DisengageWithDisable"
      CruiseOnOff
      Brake
      Speed
      CoastSetSw
      AccelResSw
      engaged
      tspeed
    baseline "Engage1stWithCoastSetSW"
      CruiseOnOff
      Brake
      Speed
      CoastSetSw
      AccelResSw
      engaged
      tspeed
    baseline "NoEngage1stWithAccelResSW"
      CruiseOnOff
      Brake
      Speed
      CoastSetSw
      AccelResSw
      engaged
      tspeed
    baseline "DisengageWithBrake"
      CruiseOnOff
      Brake
      Speed
      CoastSetSw
      AccelResSw
      engaged
      tspeed
    iterations:
      InitNotEnableOrEngaged: ExternalInput "InitNotEnableOrEngaged", Baseline "InitNotEnableOrEngaged"
      NotEngagedWithEnable: ExternalInput "NotEngagedWithEnable", Baseline "NotEngagedWithEnable"
      DisengageWithDisable: ExternalInput "DisengageWithDisable", Baseline "DisengageWithDisable"
      Engage1stWithCoastSetSW: ExternalInput "Engage1stWithCoastSetSW", Baseline "Engage1stWithCoastSetSW"
      NoEngage1stWithAccelResSW: ExternalInput "NoEngage1stWithAccelResSW", Baseline "NoEngage1stWithAccelResSW"
      DisengageWithBrake: ExternalInput "DisengageWithBrake", Baseline "DisengageWithBrake"

  case "TestSequence_Short_Adapter" [simulation]
    test data file: CruiseControl_Short_SigEditor.mat, adapter testSeqAdapter
    model CruiseControl, harness CruiseControl_Harness_MultiTestSeq
    iterations:
      case_01_InitNotEnableOrEngaged: VariableParameter:, permutationIndex: 1, name: multiTestSequence_Iter, source: base workspace, displayValue: 1, valueString: AAFJTQAAAAAOAAAAOAAAAAYAAAAIAAAABgAAAAAAAAAFAAAACAAAAAEAAAABAAAAAQAAAAAA AAAJAAAACAAAAAAAAAAAAPA/
      case_02_NotEngagedWithEnable: VariableParameter:, permutationIndex: 1, name: multiTestSequence_Iter, source: base workspace, displayValue: 2, valueString: AAFJTQAAAAAOAAAAOAAAAAYAAAAIAAAABgAAAAAAAAAFAAAACAAAAAEAAAABAAAAAQAAAAAA AAAJAAAACAAAAAAAAAAAAABA
      case_03_DisengageWithDisable: VariableParameter:, permutationIndex: 1, name: multiTestSequence_Iter, source: base workspace, displayValue: 3, valueString: AAFJTQAAAAAOAAAAOAAAAAYAAAAIAAAABgAAAAAAAAAFAAAACAAAAAEAAAABAAAAAQAAAAAA AAAJAAAACAAAAAAAAAAAAAhA
      case_04_Engage1stWithCoastSetSW: VariableParameter:, permutationIndex: 1, name: multiTestSequence_Iter, source: base workspace, displayValue: 4, valueString: AAFJTQAAAAAOAAAAOAAAAAYAAAAIAAAABgAAAAAAAAAFAAAACAAAAAEAAAABAAAAAQAAAAAA AAAJAAAACAAAAAAAAAAAABBA
      case_05_NoEngage1stWithAccelResSW: VariableParameter:, permutationIndex: 1, name: multiTestSequence_Iter, source: base workspace, displayValue: 5, valueString: AAFJTQAAAAAOAAAAOAAAAAYAAAAIAAAABgAAAAAAAAAFAAAACAAAAAEAAAABAAAAAQAAAAAA AAAJAAAACAAAAAAAAAAAABRA
      case_06_DisengageWithBrake: VariableParameter:, permutationIndex: 1, name: multiTestSequence_Iter, source: base workspace, displayValue: 6, valueString: AAFJTQAAAAAOAAAAOAAAAAYAAAAIAAAABgAAAAAAAAAFAAAACAAAAAEAAAABAAAAAQAAAAAA AAAJAAAACAAAAAAAAAAAABhA