% Requirement links of CruiseControl_TestCase.mldatx (R2018a)

item 1 links to MW_CruiseControl.slreqx#21: “Accelerate” input increases target speed only when engaged (active)
item 2 links to MW_CruiseControl.slreqx#18: “Resume” input ignored until the initial transition from disengaged (inactive) to engaged (active)
item 3 links to MW_CruiseControl.slreqx#14: Disabled (off) during start-up
item 4 links to MW_CruiseControl.slreqx#17: Initial transition from disengaged (inactive) to engaged (active) only with “Set Speed” input after enabling (on)
item 5 links to MW_CruiseControl.slreqx#16: Disengaged (not active) when disabled (off)
item 6 links to MW_CruiseControl.slreqx#19: Subsequent transition from disengaged (inactive) to engaged (active) with “Set Speed” input while enabled (on)
item 7 links to MW_CruiseControl.slreqx#20: Subsequent transition from disengaged (inactive) to engaged (active) with “Resume” input while enabled (on)
item 8 links to MW_CruiseControl.slreqx#22: “Decelerate” input decreases target speed only when engaged (active)
item 9 links to MW_CruiseControl.slreqx#26: Vehicle braking will transition system to disengaged (inactive) when engaged (active)
item 10 links to MW_CruiseControl.slreqx#15: Not engaged with enabling (on)