% Requirement links of CruiseControl_TestSuite.mldatx (R2021a)

item 1 verifies CruiseControl_TestSuite.slreqx#18: “Resume” input ignored until the initial transition from disengaged (inactive) to engaged (active)
item 2 verifies CruiseControl_TestSuite.slreqx#17: Initial transition from disengaged (inactive) to engaged (active) only with “Set Speed” input after enabling (on)
item 3 verifies CruiseControl_TestSuite.slreqx#19: Subsequent transition from disengaged (inactive) to engaged (active) with “Set Speed” input while enabled (on)
item 3 verifies CruiseControl_TestSuite.slreqx#20: Subsequent transition from disengaged (inactive) to engaged (active) with “Resume” input while enabled (on)
item 4 verifies CruiseControl_TestSuite.slreqx#22: “Decelerate” input decreases target speed only when engaged (active)
item 5 verifies CruiseControl_TestSuite.slreqx#23: Continuous “Accelerate” input increases target speed at a fixed rate and only when engaged (active)
item 6 verifies CruiseControl_TestSuite.slreqx#24: Continuous “Decelerate” input decreases target speed at a fixed rate and only when engaged (active)
item 7 verifies CruiseControl_TestSuite.slreqx#28: Transition to disengaged (inactive) when vehicle speed is outside the limits of 20 to 90 mph
item 7 verifies CruiseControl_TestSuite.slreqx#29: Target speed will be limited between 20 and 90 mph
item 8 verifies CruiseControl_TestSuite.slreqx#21: “Accelerate” input increases target speed only when engaged (active)
item 9 verifies CruiseControl_TestSuite.slreqx#26: Vehicle braking will transition system to disengaged (inactive) when engaged (active)
item 9 verifies CruiseControl_TestSuite.slreqx#34: Disengage when braking occurs
item 10 verifies CruiseControl_TestSuite.slreqx#16: Disengaged (not active) when disabled (off)
item 11 verifies CruiseControl_TestSuite.slreqx#14: Disabled (off) during start-up
item 12 verifies CruiseControl_TestSuite.slreqx#27: Transition to engaged (active) will only be permitted for vehicle speeds between 20 and 90 mph
item 12 verifies CruiseControl_TestSuite.slreqx#29: Target speed will be limited between 20 and 90 mph
item 13 verifies CruiseControl_TestSuite.slreqx#15: Not engaged with enabling (on)