test file "CruiseControlTests_ImportXLSadapter"
  coverage: Decision, MCDC, Condition

suite "Test Suite"

  case "Import_XLS_Short_Adapter" [baseline]
    test data file: CruiseControlTests_ImportAdapter.xlsx, adapter XLSadaptor
    model CruiseControl
    parameter set "case_01_Init_Not_Enable_or_Engaged_CALS.mat" (off): holdrate = 5, incdec = 1, maxtspeed = 90, mintspeed = 20
    parameter set "case_02_Not_Engaged_with_Enable_CALS.mat" (off): holdrate = 5, incdec = 1, maxtspeed = 90, mintspeed = 20
    parameter set "case_03_Disengage_with_Disable_CALS.mat" (off): holdrate = 5, incdec = 1, maxtspeed = 90, mintspeed = 20
    parameter set "case_04_Engage_1st_with_CoastSetSW_CALS.mat" (off): holdrate = 5, incdec = 1, maxtspeed = 90, mintspeed = 20
    parameter set "case_05_No_Engage_1st_with_AccelResSW_CALS.mat" (off): holdrate = 5, incdec = 1, maxtspeed = 90, mintspeed = 20
    parameter set "case_06_Disengage_with_Brake_CALS.mat": holdrate = 5, incdec = 1, maxtspeed = 90, mintspeed = 20
    input "case_01_Init_Not_Enable_or_Engaged_INPUTS.mat", mapped to CruiseOnOff, Brake, Speed, CoastSetSw, AccelResSw
    input "case_02_Not_Engaged_with_Enable_INPUTS.mat", mapped to CruiseOnOff, Brake, Speed, CoastSetSw, AccelResSw
    input "case_03_Disengage_with_Disable_INPUTS.mat", mapped to CruiseOnOff, Brake, Speed, CoastSetSw, AccelResSw
    input "case_04_Engage_1st_with_CoastSetSW_INPUTS.mat", mapped to CruiseOnOff, Brake, Speed, CoastSetSw, AccelResSw
    input "case_05_No_Engage_1st_with_AccelResSW_INPUTS.mat", mapped to CruiseOnOff, Brake, Speed, CoastSetSw, AccelResSw
    input "case_06_Disengage_with_Brake_INPUTS.mat", mapped to CruiseOnOff, Brake, Speed, CoastSetSw, AccelResSw (active)
    baseline "case_01_Init_Not_Enable_or_Engaged_BASELINE.mat"
      engaged
      tspeed
    baseline "case_02_Not_Engaged_with_Enable_BASELINE.mat"
      engaged
      tspeed
    baseline "case_03_Disengage_with_Disable_BASELINE.mat"
      engaged
      tspeed
    baseline "case_04_Engage_1st_with_CoastSetSW_BASELINE.mat"
      engaged
      tspeed
    baseline "case_05_No_Engage_1st_with_AccelResSW_BASELINE.mat"
      engaged
      tspeed
    baseline "case_06_Disengage_with_Brake_BASELINE.mat"
      engaged
      tspeed
    iterations:
      case_01_Init_Not_Enable_or_Engaged: ExternalInput "case_01_Init_Not_Enable_or_Engaged_INPUTS.mat", ParameterSet "case_01_Init_Not_Enable_or_Engaged_CALS.mat", Baseline "case_01_Init_Not_Enable_or_Engaged_BASELINE.mat"
      case_02_Not_Engaged_with_Enable: ExternalInput "case_02_Not_Engaged_with_Enable_INPUTS.mat", ParameterSet "case_02_Not_Engaged_with_Enable_CALS.mat", Baseline "case_02_Not_Engaged_with_Enable_BASELINE.mat"
      case_03_Disengage_with_Disable: ExternalInput "case_03_Disengage_with_Disable_INPUTS.mat", ParameterSet "case_03_Disengage_with_Disable_CALS.mat", Baseline "case_03_Disengage_with_Disable_BASELINE.mat"
      case_04_Engage_1st_with_CoastSetSW: ExternalInput "case_04_Engage_1st_with_CoastSetSW_INPUTS.mat", ParameterSet "case_04_Engage_1st_with_CoastSetSW_CALS.mat", Baseline "case_04_Engage_1st_with_CoastSetSW_BASELINE.mat"
      case_05_No_Engage_1st_with_AccelResSW: ExternalInput "case_05_No_Engage_1st_with_AccelResSW_INPUTS.mat", ParameterSet "case_05_No_Engage_1st_with_AccelResSW_CALS.mat", Baseline "case_05_No_Engage_1st_with_AccelResSW_BASELINE.mat"
      case_06_Disengage_with_Brake: ExternalInput "case_06_Disengage_with_Brake_INPUTS.mat", ParameterSet "case_06_Disengage_with_Brake_CALS.mat", Baseline "case_06_Disengage_with_Brake_BASELINE.mat"