test file "CruiseControlTests_BuiltIn"

suite "Test Suite"

  case "SigEditorBlock_Short_BuiltIn" [simulation]
    model CruiseControl, harness CruiseControl_Harness_SigEditor
    signal scenario: Disengage_with_Brake (CruiseControl_Harness_SigEditor/TestCases)
    iterations:
      Disengage_with_Brake: SignalBuilderGroup "Disengage_with_Brake"
      Disengage_with_Disable: SignalBuilderGroup "Disengage_with_Disable"
      Engage_1st_with_CoastSetSW: SignalBuilderGroup "Engage_1st_with_CoastSetSW"
      Init_Not_Enable_or_Engaged: SignalBuilderGroup "Init_Not_Enable_or_Engaged"
      No_Engage_1st_with_AccelResSW: SignalBuilderGroup "No_Engage_1st_with_AccelResSW"
      Not_Engaged_with_Enable: SignalBuilderGroup "Not_Engaged_with_Enable"

  case "Import_XLS_Short_BuiltIn" [baseline]
    model CruiseControl
    input "InitNotEnableOrEngaged" from CruiseControlTests_Import_BuiltIn.xlsx, sheet InitNotEnableOrEngaged A:F, mapped to CruiseOnOff, Brake, Speed, CoastSetSw, AccelResSw (active)
    input "NotEngagedWithEnable" from CruiseControlTests_Import_BuiltIn.xlsx, sheet NotEngagedWithEnable A:F, mapped to CruiseOnOff, Brake, Speed, CoastSetSw, AccelResSw
    input "DisengageWithDisable" from CruiseControlTests_Import_BuiltIn.xlsx, sheet DisengageWithDisable A:F, mapped to CruiseOnOff, Brake, Speed, CoastSetSw, AccelResSw
    input "Engage1stWithCoastSetSW" from CruiseControlTests_Import_BuiltIn.xlsx, sheet Engage1stWithCoastSetSW A:F, mapped to CruiseOnOff, Brake, Speed, CoastSetSw, AccelResSw
    input "NoEngage1stWithAccelResSW" from CruiseControlTests_Import_BuiltIn.xlsx, sheet NoEngage1stWithAccelResSW A:F, mapped to CruiseOnOff, Brake, Speed, CoastSetSw, AccelResSw
    input "DisengageWithBrake" from CruiseControlTests_Import_BuiltIn.xlsx, sheet DisengageWithBrake A:F, mapped to CruiseOnOff, Brake, Speed, CoastSetSw, AccelResSw
    baseline "InitNotEnableOrEngaged"
      engaged
      tspeed
    baseline "NotEngagedWithEnable"
      engaged
      tspeed
    baseline "DisengageWithDisable"
      engaged
      tspeed
    baseline "Engage1stWithCoastSetSW"
      engaged
      tspeed
    baseline "NoEngage1stWithAccelResSW"
      engaged
      tspeed
    baseline "DisengageWithBrake"
      engaged
      tspeed
    iterations:
      InitNotEnableOrEngaged: ExternalInput "InitNotEnableOrEngaged", Baseline "InitNotEnableOrEngaged"
      NotEngagedWithEnable: ExternalInput "NotEngagedWithEnable", Baseline "NotEngagedWithEnable"
      DisengageWithDisable: ExternalInput "DisengageWithDisable", Baseline "DisengageWithDisable"
      Engage1stWithCoastSetSW: ExternalInput "Engage1stWithCoastSetSW", Baseline "Engage1stWithCoastSetSW"
      NoEngage1stWithAccelResSW: ExternalInput "NoEngage1stWithAccelResSW", Baseline "NoEngage1stWithAccelResSW"
      DisengageWithBrake: ExternalInput "DisengageWithBrake", Baseline "DisengageWithBrake"