test file "CruiseControlTestsCI"

suite "Test Suite"

  case "Test Case" [baseline]
    test data file: CruiseControlTests_Import_BuiltIn.xlsx
    model CruiseControl
    input "InitNotEnableOrEngaged" from CruiseControlTests_Import_BuiltIn.xlsx, mapped to CruiseOnOff, Brake, Speed, CoastSetSw, AccelResSw
    input "NotEngagedWithEnable" from CruiseControlTests_Import_BuiltIn.xlsx, mapped to CruiseOnOff, Brake, Speed, CoastSetSw, AccelResSw
    input "DisengageWithDisable" from CruiseControlTests_Import_BuiltIn.xlsx, mapped to CruiseOnOff, Brake, Speed, CoastSetSw, AccelResSw
    input "Engage1stWithCoastSetSW" from CruiseControlTests_Import_BuiltIn.xlsx, mapped to CruiseOnOff, Brake, Speed, CoastSetSw, AccelResSw
    input "NoEngage1stWithAccelResSW" from CruiseControlTests_Import_BuiltIn.xlsx, mapped to CruiseOnOff, Brake, Speed, CoastSetSw, AccelResSw
    input "DisengageWithBrake" from CruiseControlTests_Import_BuiltIn.xlsx, mapped to CruiseOnOff, Brake, Speed, CoastSetSw, AccelResSw
    logged signals "Signal Set 1": engaged, tspeed, AccelResSw, CoastSetSw, Speed, Brake, CruiseOnOff
    baseline "InitNotEnableOrEngaged"
      engaged
      tspeed
    baseline "NotEngagedWithEnable"
      engaged
      tspeed
    baseline "DisengageWithDisable"
      engaged
      tspeed
    baseline "Engage1stWithCoastSetSW"
      engaged
      tspeed
    baseline "NoEngage1stWithAccelResSW"
      engaged
      tspeed
    baseline "DisengageWithBrake"
      engaged
      tspeed
    iterations:
      InitNotEnableOrEngaged: ExternalInput "InitNotEnableOrEngaged", Baseline "InitNotEnableOrEngaged"
      NotEngagedWithEnable: ExternalInput "NotEngagedWithEnable", Baseline "NotEngagedWithEnable"
      DisengageWithDisable: ExternalInput "DisengageWithDisable", Baseline "DisengageWithDisable"
      Engage1stWithCoastSetSW: ExternalInput "Engage1stWithCoastSetSW", Baseline "Engage1stWithCoastSetSW"
      NoEngage1stWithAccelResSW: ExternalInput "NoEngage1stWithAccelResSW", Baseline "NoEngage1stWithAccelResSW"
      DisengageWithBrake: ExternalInput "DisengageWithBrake", Baseline "DisengageWithBrake"