test file "CruiseControl_TAL.m"

suite "Temporal Assessment Language"

  case "HarnessSupported" [simulation]
    model CruiseControl_TAL, harness CruiseControl_Harness_SigEditor
    input "InitNotEnableOrEngaged" from CruiseControlTests_Import_Std.xlsx (active)
    input "NotEngagedWithEnable" from CruiseControlTests_Import_Std.xlsx
    input "DisengageWithDisable" from CruiseControlTests_Import_Std.xlsx
    input "Engage1stWithCoastSetSW" from CruiseControlTests_Import_Std.xlsx
    input "NoEngage1stWithAccelResSW" from CruiseControlTests_Import_Std.xlsx
    input "DisengageWithBrake" from CruiseControlTests_Import_Std.xlsx
    assessment "Disengage_With_Brake": At any point of time, whenever Brake & engaged_was is true then, with no delay, ~engaged must be true
    assessment "Disengage_with_Disable": At any point of time, if ~CruiseOnOff & CruiseOnOff_was & engaged_was becomes true then, with no delay, ~engaged must be true
    assessment "Enage_1st_with_CoastSetSw": At any point of time, whenever CoastSetSw & engaged_never_was & Speed>=mintspeed & Speed<=maxtspeed is true then, with no delay, engaged must be true
    assessment "Init_Not_Enable_or_Engaged": At any point of time, whenever ~CruiseOnOff is true then, with no delay, ~engaged & tspeed==uint8(0) must be true
    assessment "No_Engage_1st_with_AccelResSW": At any point of time, whenever AccelRestSw & engaged_never_was & Speed>=mintspeed & Speed<=maxtspeed is true then, with no delay, ~engaged must be true
    assessment "Not_Engaged_with_Enable": At any point of time, if CruiseOnOff becomes true then, with no delay, ~engaged & tspeed==uint8(0) must be true
      Brake: signal CruiseControl_Harness_SigEditor/Input Conversion Subsystem, port 2
      engaged: signal CruiseControl_Harness_SigEditor/CruiseControl, port 1
      engaged_was: signal CruiseControl_Harness_SigEditor/TAL_helper/Unit Delay5, port 1
      CruiseOnOff: signal CruiseControl_Harness_SigEditor/Input Conversion Subsystem, port 1
      CruiseOnOff_was: signal CruiseControl_Harness_SigEditor/TAL_helper/Unit Delay, port 1
      CoastSetSw: signal CruiseControl_Harness_SigEditor/Input Conversion Subsystem, port 4
      mintspeed: variable CruiseControl_Harness_SigEditor/CruiseControl
      maxtspeed: variable CruiseControl_Harness_SigEditor/CruiseControl
      Speed: signal CruiseControl_Harness_SigEditor/Input Conversion Subsystem, port 3
      engaged_never_was: signal CruiseControl_Harness_SigEditor/TAL_helper/Unit Delay8, port 1
      tspeed: signal CruiseControl_Harness_SigEditor/CruiseControl, port 2
      AccelRestSw: signal CruiseControl_Harness_SigEditor/Input Conversion Subsystem, port 5
    iterations:
      Disengage_with_Brake: SignalBuilderGroup "Disengage_with_Brake", Assessments "[\"Disengage_With_Brake\"]"
      Disengage_with_Disable: SignalBuilderGroup "Disengage_with_Disable", Assessments "[\"Disengage_with_Disable\"]"
      Engage_1st_with_CoastSetSW: SignalBuilderGroup "Engage_1st_with_CoastSetSW", Assessments "[\"Enage_1st_with_CoastSetSw\"]"
      Init_Not_Enable_or_Engaged: SignalBuilderGroup "Init_Not_Enable_or_Engaged", Assessments "[\"Init_Not_Enable_or_Engaged\"]"
      No_Engage_1st_with_AccelResSW: SignalBuilderGroup "No_Engage_1st_with_AccelResSW", Assessments "[\"No_Engage_1st_with_AccelResSW\"]"
      Not_Engaged_with_Enable: SignalBuilderGroup "Not_Engaged_with_Enable", Assessments "[\"Not_Engaged_with_Enable\"]"