test file "topItOff"
  coverage: Decision, MCDC, Condition

suite "Test Suite"

  case "PartialCov" [simulation]
    model CruiseControl, harness CruiseControl_Harness_SB
    signal scenario: Init Not Enable or Engaged (CruiseControl_Harness_SB/Harness Inputs)
    iteration script:
      %% Iterate over all Signal Builder Groups.

      % Determine the number of possible iterations
      numSteps = length(sltest_signalBuilderGroups);

      % Create each iteration
      for k = 1 : numSteps
          % Set up a new iteration object
          testItr = sltestiteration();

          % Set iteration settings
          setTestParam(testItr, 'SignalBuilderGroup', sltest_signalBuilderGroups{k});

          % Register the iteration to run in this test case
          addIteration(sltest_testCase, testItr, sltest_signalBuilderGroups{k}); % You can pass in an optional iteration name
      end