test file "topItOff_SIL"
  coverage: Decision, MCDC, Condition

suite "Test Suite"

  case "PartialCov" [simulation]
    model CruiseControl, harness CruiseControl_Harness_SB
    signal scenario: Init Not Enable or Engaged (CruiseControl_Harness_SB/Harness Inputs)
    iteration script:
      %% Iterate over all Signal Builder Groups.

      % Determine the number of possible iterations
      numSteps = length(sltest_signalBuilderGroups);

      % Create each iteration
      for k = 1 : numSteps
          % Set up a new iteration object
          testItr = sltestiteration();

          % Set iteration settings
          setTestParam(testItr, 'SignalBuilderGroup', sltest_signalBuilderGroups{k});

          % Register the iteration to run in this test case
          addIteration(sltest_testCase, testItr, sltest_signalBuilderGroups{k}); % You can pass in an optional iteration name
      end

  case "Generated" [baseline]
    model CruiseControl, harness CruiseControl_Harness1, mode Software-in-the-Loop (SIL)
    input "Test Case:1" from CruiseControl_sldvdata.mat (active)
    input "Test Case:2" from CruiseControl_sldvdata.mat
    input "Test Case:3" from CruiseControl_sldvdata.mat
    input "Test Case:4" from CruiseControl_sldvdata.mat
    input "Test Case:5" from CruiseControl_sldvdata.mat
    input "Test Case:6" from CruiseControl_sldvdata.mat
    input "Test Case:7" from CruiseControl_sldvdata.mat
    input "Test Case:8" from CruiseControl_sldvdata.mat
    input "Design Verifier (CruiseControl_sldvdata.mat)" from CruiseControl_sldvdata.mat
    baseline "TestCase_1.mat"
      engaged
      tspeed
    baseline "TestCase_2.mat"
      engaged
      tspeed
    baseline "TestCase_3.mat"
      engaged
      tspeed
    baseline "TestCase_4.mat"
      engaged
      tspeed
    baseline "TestCase_5.mat"
      engaged
      tspeed
    baseline "TestCase_6.mat"
      engaged
      tspeed
    baseline "TestCase_7.mat"
      engaged
      tspeed
    baseline "TestCase_8.mat"
      engaged
      tspeed
    iterations:
      Iteration1: ExternalInput "Test Case:1", Baseline "TestCase_1.mat"
      Iteration2: ExternalInput "Test Case:2", Baseline "TestCase_2.mat"
      Iteration3: ExternalInput "Test Case:3", Baseline "TestCase_3.mat"
      Iteration4: ExternalInput "Test Case:4", Baseline "TestCase_4.mat"
      Iteration5: ExternalInput "Test Case:5", Baseline "TestCase_5.mat"
      Iteration6: ExternalInput "Test Case:6", Baseline "TestCase_6.mat"
      Iteration7: ExternalInput "Test Case:7", Baseline "TestCase_7.mat"
      Iteration8: ExternalInput "Test Case:8", Baseline "TestCase_8.mat"

suite "Test Suite_SIL"

  case "PartialCov" [simulation]
    model CruiseControl, harness CruiseControl_Harness_SB, mode Software-in-the-Loop (SIL)
    signal scenario: Init Not Enable or Engaged (CruiseControl_Harness_SB/Harness Inputs)
    iteration script: same code as in iteration script of case "PartialCov"

  case "Generated" [baseline]
    model CruiseControl, harness CruiseControl_Harness1, mode Normal
    input "Test Case:1" from CruiseControl_sldvdata.mat (active)
    input "Test Case:2" from CruiseControl_sldvdata.mat
    input "Test Case:3" from CruiseControl_sldvdata.mat
    input "Test Case:4" from CruiseControl_sldvdata.mat
    input "Test Case:5" from CruiseControl_sldvdata.mat
    input "Test Case:6" from CruiseControl_sldvdata.mat
    input "Test Case:7" from CruiseControl_sldvdata.mat
    input "Test Case:8" from CruiseControl_sldvdata.mat
    input "Design Verifier (CruiseControl_sldvdata.mat)" from CruiseControl_sldvdata.mat
    baseline "TestCase_1.mat"
      engaged
      tspeed
    baseline "TestCase_2.mat"
      engaged
      tspeed
    baseline "TestCase_3.mat"
      engaged
      tspeed
    baseline "TestCase_4.mat"
      engaged
      tspeed
    baseline "TestCase_5.mat"
      engaged
      tspeed
    baseline "TestCase_6.mat"
      engaged
      tspeed
    baseline "TestCase_7.mat"
      engaged
      tspeed
    baseline "TestCase_8.mat"
      engaged
      tspeed
    iterations:
      Iteration1: ExternalInput "Test Case:1", Baseline "TestCase_1.mat"
      Iteration2: ExternalInput "Test Case:2", Baseline "TestCase_2.mat"
      Iteration3: ExternalInput "Test Case:3", Baseline "TestCase_3.mat"
      Iteration4: ExternalInput "Test Case:4", Baseline "TestCase_4.mat"
      Iteration5: ExternalInput "Test Case:5", Baseline "TestCase_5.mat"
      Iteration6: ExternalInput "Test Case:6", Baseline "TestCase_6.mat"
      Iteration7: ExternalInput "Test Case:7", Baseline "TestCase_7.mat"
      Iteration8: ExternalInput "Test Case:8", Baseline "TestCase_8.mat"

suite "New Test Suite 1"

  case "New Test Case 1" [baseline]
    model CruiseControl, harness CruiseControl_Harness1
    input "Test Case:1" from CruiseControl_sldvdata.mat (active)
    input "Test Case:2" from CruiseControl_sldvdata.mat
    input "Test Case:3" from CruiseControl_sldvdata.mat
    input "Test Case:4" from CruiseControl_sldvdata.mat
    input "Test Case:5" from CruiseControl_sldvdata.mat
    input "Test Case:6" from CruiseControl_sldvdata.mat
    input "Test Case:7" from CruiseControl_sldvdata.mat
    input "Test Case:8" from CruiseControl_sldvdata.mat
    input "Design Verifier (CruiseControl_sldvdata.mat)" from CruiseControl_sldvdata.mat
    baseline "TestCase_1.mat"
      engaged:1
      tspeed:1
    baseline "TestCase_2.mat"
      engaged:1
      tspeed:1
    baseline "TestCase_3.mat"
      engaged:1
      tspeed:1
    baseline "TestCase_4.mat"
      engaged:1
      tspeed:1
    baseline "TestCase_5.mat"
      engaged:1
      tspeed:1
    baseline "TestCase_6.mat"
      engaged:1
      tspeed:1
    baseline "TestCase_7.mat"
      engaged:1
      tspeed:1
    baseline "TestCase_8.mat"
      engaged:1
      tspeed:1
    iterations:
      Iteration1: ExternalInput "Test Case:1", Baseline "TestCase_1.mat"
      Iteration2: ExternalInput "Test Case:2", Baseline "TestCase_2.mat"
      Iteration3: ExternalInput "Test Case:3", Baseline "TestCase_3.mat"
      Iteration4: ExternalInput "Test Case:4", Baseline "TestCase_4.mat"
      Iteration5: ExternalInput "Test Case:5", Baseline "TestCase_5.mat"
      Iteration6: ExternalInput "Test Case:6", Baseline "TestCase_6.mat"
      Iteration7: ExternalInput "Test Case:7", Baseline "TestCase_7.mat"
      Iteration8: ExternalInput "Test Case:8", Baseline "TestCase_8.mat"